# Grasshopper definition 160406_CityMatrix.gh (Grasshopper 0.9.76)
# plug-ins: Python Interpreter

# ---- group: original grid dimension
number_slider = Slider(34.331, range=1..100)

# ---- group: input method 1 - colortizer data
# CityMatrix
# 
# by Yan "Ryan" Zhang <ryanz@mit.edu>
# for MIT Media Lab, Changing Place Group, CityScope Project
# March.17th.2016
# Parsing Colortizer Data (CityMatrix 16x16)
panel = Panel("C:\Users\RYAN\Documents\GitHub\CityMatrix\Data\colortizer_data.txt")

# ---- group: colortizer orgin
pt = Point(<point referenced from the Rhino model>)

# ---- group: grid total size ref pt
pt_2 = Point(<point referenced from the Rhino model>)

# ---- group: building heights
number_slider_2 = Slider(0.1, range=0.1..100)
number_slider_3 = Slider(25, range=1..100)
number_slider_4 = Slider(50, range=1..100)
number_slider_5 = Slider(80, range=1..100)

# ---- group: randam seed for context
# data1: 0 to 5465
number_slider_6 = Slider(0, range=0..20000)

# ----
# temp blocks
xy = XYPlane(Origin=pt)
number_slider_7 = Slider(0, range=0..100)
number_slider_8 = Slider(5465, range=0..5465)
# data2: 1 to 4500
number_slider_9 = Slider(4500, range=1..4500)
dist = Distance(PointA=pt, PointB=pt_2)
division = Division(A=dist, B=16)

# ---- group: grid size
num = Number(division)

# ----
neg = Negative(Value=num)

# ---- group: new grid size ratio
division_2 = Division(A=num, B=number_slider)

# ----
int = Integer(number_slider_6)
# 0, 10, 20, 50
merge = Merge(Data1=number_slider_2, Data2=number_slider_3, Data3=number_slider_4, Data4=number_slider_5)
dom = ConstructDomain(DomainStart=number_slider_7, DomainEnd=num)
dom_2 = ConstructDomain(DomainStart=number_slider_7, DomainEnd=neg)

# ---- group: colortizer data
file = ReadFile(File=panel, PerLineParse=True)

# ----
split = SplitList(List=file, Index=1)  # -> ListA, ListB
split_2 = TextSplit(Text=split.ListA, Separators="\t")
split_3 = TextSplit(Text=split.ListB, Separators="\t")
pshift = ShiftPaths(Data=split_3, Offset=1)
pshift_2 = ShiftPaths(Data=split_2, Offset=1)
pshift_3 = ShiftPaths(Data=pshift, Offset=1)
pshift_4 = ShiftPaths(Data=pshift_2, Offset=1)
division_3 = Division(A=num, B=2)
division_4 = Division(A=num, B=2)
int_2 = Integer(pshift_3)
txt = Text(pshift_4)
Z = UnitZ(Factor=1)

# ---- group: data tree to python list example
python = PythonScript()  # -> out, a; inputs DataTree: tree of Int32; disabled
# ---------- python: Python ----------
import clr
clr.AddReference("Grasshopper")
import Grasshopper as gh


def ghDataTreeToPythonList(dataTree):
    
    """ Converts a GH datatree to a nested Python list """
    
    # Create an empty Python list
    pyList = []
    
    # Add the branches of the Gh datatree to this list
    for i in range(DataTree.BranchCount):
        branch = list(DataTree.Branch(i))
        pyList.append(branch)
        
    return pyList

def pythonListTGhDataTree(pythonList):
    
    """ Converts a  nested Python list to a GH datatree """
    
    # Create GH datatree
    dataTree = gh.DataTree[int]()
    
    # Add pythonlist sub lists to dataTree
    for i,l in enumerate(pythonList):
        for v in l:
            dataTree.Add(v,gh.Kernel.Data.GH_Path(i))
            
    return dataTree


# Convert the GH DataTree to nested list and check its content
pyList = ghDataTreeToPythonList(DataTree)
print type(pyList)
print len(pyList)
print pyList[0]
print pyList

# Do something with pyList 
pyList = [[j + 2 for j in sublist] for sublist in pyList]
print pyList

# Convert pyList to Gh Datatree and return it to GH
a = pythonListTGhDataTree(pyList)
# ---------- end python ----------

# ----
panel_2 = Panel(txt)
panel_3 = Panel(int_2)

# ---- group: sticky["blnInitiated"]
python_2 = PythonScript()  # -> out, blnInitiated
# ---------- python_2: Python ----------
"""
Realtime Simulator

written by Yan "Ryan" Zhang <ryanz@mit.edu>
for MIT Media Lab, Changing Place Group, CityScope Project
March.7th.2016
"""


import scriptcontext as sc

sc.sticky["blnInitiated"] = False
blnInitiated = sc.sticky["blnInitiated"]
# ---------- end python_2 ----------

# ----
number_slider_10 = Slider(43, range=0..1000)  # disabled
panel_4 = Panel(python_2.blnInitiated)
panel_5 = Panel(python_2.out)
merge_2 = Merge(
    Data1=ColourSwatch(SwatchColor=RGBA(0, 0, 0, 0)),
    Data2=ColourSwatch(SwatchColor=RGB(0, 128, 128)),
    Data3=ColourSwatch(SwatchColor=RGB(128, 87, 0)),
    Data4=ColourSwatch(SwatchColor=RGB(30, 128, 0)))
item = ListItem(List=panel_3, Index="3", Wrap=False)
item_2 = ListItem(List=panel_3, Index="0", Wrap=False)
item_3 = ListItem(List=panel_3, Index="1", Wrap=False)
item_4 = ListItem(List=panel_3, Index="2", Wrap=False)

# ---- group: rotation
pshift_5 = ShiftPaths(Data=item, Offset=-1)

# ---- group: module id
pshift_6 = ShiftPaths(Data=item_2, Offset=-1)

int_3 = Integer(pshift_6)

# ----
lng = ListLength(List=int_3)
larger = LargerThan(FirstNumber=int_3, SecondNumber="2")  # -> LargerThan, OrEqualTo
repeat = RepeatData(Data="-1", Length=lng)

# ---- group: filter id larger than 2
p_n_c = PickNChoose(Pattern=larger.LargerThan, Stream0=int_3, Stream1=repeat)

# ---- group: id to selection
addition = Addition(A=p_n_c, B="1")

# ----
item_5 = ListItem(List=merge, Index=addition, Wrap=False)
multiplication = Multiplication(A=item_5, B=division_2)

# ---- group: height from colotizer
num_2 = Number(multiplication)

# ---- group: height!
num_3 = Number(num_2)

# ----
division_5 = Division(A=num_3, B=Slider(2, range=0..10))
dom_3 = ConstructDomain(DomainStart=number_slider_7, DomainEnd=division_5)
box = DomainBox(Base=xy, X=dom, Y=dom_2, Z=dom_3)
panel_6 = Panel(num_2)
item_6 = ListItem(List=merge_2, Index=addition, Wrap=False)

# ---- group: x
pshift_7 = ShiftPaths(Data=item_3, Offset=-1)

# ----
multiplication_2 = Multiplication(A=pshift_7, B=num)
addition_2 = Addition(A=multiplication_2, B=division_3)
X = UnitX(Factor=multiplication_2)
move = Move(Geometry=box, Motion=X)  # -> Geometry, Transform

# ---- group: y
pshift_8 = ShiftPaths(Data=item_4, Offset=-1)

# ----
multiplication_3 = Multiplication(A=pshift_8, B=neg)
subtraction = Subtraction(A=multiplication_3, B=division_4)
pt_3 = PointOriented(BasePlane=xy, UComponent=addition_2, VComponent=subtraction, WComponent=0)
line = LineSDL(Start=pt_3, Direction=Z, Length="100")
Y = UnitY(Factor=multiplication_3)
move_2 = Move(Geometry=move.Geometry, Motion=Y)  # -> Geometry, Transform

# ---- group: Parsed volume
box_2 = Box(move_2.Geometry)

# ----
item_7 = ListItem(List=box_2, Index=number_slider_10, Wrap=True)  # disabled

# ---- group: current and last heights
# trigger01 means height changed or not
python_3 = PythonScript(x=num_3)  # -> out, currentHeights, lastHeights, blnInitiated, trigger01; inputs x: list
# ---------- python_3: Python ----------
"""
Realtime Simulator

written by Yan "Ryan" Zhang <ryanz@mit.edu>
for MIT Media Lab, Changing Place Group, CityScope Project
March.7th.2016
"""

import scriptcontext as sc

if sc.sticky["blnInitiated"] == False: 
    sc.sticky["blnInitiated"] = True
    sc.sticky["lastHeights"] = x
    sc.sticky["currentHeights"] = x
else: 
    sc.sticky["lastHeights"] = sc.sticky["currentHeights"]
    sc.sticky["currentHeights"] = x


blnInitiated = sc.sticky["blnInitiated"]
lastHeights = sc.sticky["lastHeights"]
currentHeights = sc.sticky["currentHeights"]

if not lastHeights == currentHeights:
    trigger01 = True
else:
    trigger01 = False
# ---------- end python_3 ----------

# ---- group: compare get surrounding for predict export
python_4 = PythonScript(trigger01=python_3.trigger01)  # -> out, heights
# ---------- python_4: Python ----------
"""
Realtime Simulator

written by Yan "Ryan" Zhang <ryanz@mit.edu>
for MIT Media Lab, Changing Place Group, CityScope Project
March.7th.2016
"""


import rhinoscriptsyntax as rs
import scriptcontext as sc
import clr
clr.AddReference("Grasshopper")
import Grasshopper as gh


# call main()
if trigger01 and sc.sticky["blnInitiated"] == True:
    heights = main()


# main function
def main():
    currentHeights = sc.sticky["currentHeights"]
    lastHeights = sc.sticky["lastHeights"]
    diffs = []
    for i in range(0, len(currentHeights)):
        hc = currentHeights[i]
        hl = lastHeights[i]
        if not hc == hl:
            diffs.append(i)
    
    if len(diffs) > 0:
        
        xSteps = sc.sticky["xSteps"]
        ySteps = sc.sticky["ySteps"]
        for diff in diffs:
            print "differet module found! at number: ", diff
            print "x step = ", xSteps[diff]
            print "y step = ", ySteps[diff]
            print "lastHeights = ", lastHeights[diff]
            print "currentHeights = ", currentHeights[diff]
        
        # do the first diff first, TODO: loop each diff later
        diff = diffs[0]
        xs = range(int(xSteps[diff])-2,int(xSteps[diff])+2+1)
        ys = range(int(ySteps[diff])-2,int(ySteps[diff])+2+1)
        
        # bufferMatrix: 5 by 5 matrix (list of list), element is a list of
        # [x, y, valid(in bound), n(order in data list), height] 
        # if not valid, height = 0.030934
        
        # initiate bufferMatrix
        bufferMatrix = [[[],[],[],[],[]],
                        [[],[],[],[],[]],
                        [[],[],[],[],[]],
                        [[],[],[],[],[]],
                        [[],[],[],[],[]]]
        #for i in range(5): tempRow.append([0,0,0,0,0]) #doesn't work!
        
        # fill bufferMatrix
        for j in range(5):
            for i in range(5):
                #print "i: ", i, "; j: ", j
                x = xs[i]
                y = ys[j]
                #print "x: ", x, "; y: ", y
                if x >= 0 and x <= 15 and y >= 0 and y <= 15:
                    v = 1 #valid/in bound = 1, not valid = 0
                    n = xy2n(x,y)
                    h = lastHeights[n]
                else: 
                    v = 0 #not valid
                    n = -1 #not valid
                    h = 0.030934
                bufferMatrix[j][i] = [x,y,v,n,h]
        print "bufferMatrix: - [x,y,v,n,h]\n", bufferMatrix
        sc.sticky["bufferMatrix"] = bufferMatrix
        
        # export height list in right order
        # first is the center and then y 4 to 0, then x 0 to 4
        hs = []
        hs.append(bufferMatrix[2][2][4])
        n = 1
        for i in range(0,5):
            for j in range(0,5):
                if not (i==2 and 4-j==2):
                    #print "x: ", i, "; y: ", 4-j, "; n: ", n
                    hs.append(bufferMatrix[4-j][i][4])
                    n += 1
        print "height list hs[]: \n", hs
    
    # output heights, need to pass outside the main function!
    return hs


# project functions
# given x step and y step return height id
def xy2n(x,y):
    n = y + (15 - x) * 16
    return n


# library functions
# gh data tree and py list
def ghDataTreeToPythonList(dataTree):
    
    """ Converts a GH datatree to a nested Python list """
    
    # Create an empty Python list
    pyList = []
    
    # Add the branches of the Gh datatree to this list
    for i in range(DataTree.BranchCount):
        branch = list(DataTree.Branch(i))
        pyList.append(branch)
        
    return pyList

def pythonListTGhDataTree(pythonList):
    
    """ Converts a  nested Python list to a GH datatree """
    
    # Create GH datatree
    dataTree = gh.DataTree[int]()
    
    # Add pythonlist sub lists to dataTree
    for i,l in enumerate(pythonList):
        for v in l:
            dataTree.Add(v,gh.Kernel.Data.GH_Path(i))
            
    return dataTree

def dataTreePythonListExample():
    # Convert the GH DataTree to nested list and check its content
    pyList = ghDataTreeToPythonList(DataTree)
    print type(pyList)
    print len(pyList)
    print pyList[0]
    print pyList
    
    # Do something with pyList 
    pyList = [[j + 2 for j in sublist] for sublist in pyList]
    print pyList
    
    # Convert pyList to Gh Datatree and return it to GH
    a = pythonListTGhDataTree(pyList)
# ---------- end python_4 ----------

# ----
panel_7 = Panel(python_4.heights)
panel_8 = Panel(python_4.out)
panel_9 = Panel(pshift_7)
panel_10 = Panel(pshift_8)
panel_11 = Panel(pshift_5)
panel_12 = Panel(pshift_6)
division_6 = Division(A=panel_7, B=division_2)
preview = CustomPreview(Geometry=box_2, Shader=item_6)
multiplication_4 = Multiplication(A=division_6, B=10)
panel_13 = Panel(python_3.blnInitiated)
panel_14 = Panel(python_3.lastHeights)
panel_15 = Panel(python_3.out)
int_4 = Integer(multiplication_4)
division_7 = Division(A=int_4, B=10)
panel_16 = Panel(division_7)
panel_17 = Panel(python_3.currentHeights)

# ---- group: sticky rotations
python_5 = PythonScript(x=panel_11)  # -> out, rotations; inputs x: list
# ---------- python_5: Python ----------
"""
Realtime Simulator

written by Yan "Ryan" Zhang <ryanz@mit.edu>
for MIT Media Lab, Changing Place Group, CityScope Project
March.7th.2016
"""

import scriptcontext as sc

sc.sticky["rotations"] = x

rotations = sc.sticky["rotations"]
# ---------- end python_5 ----------

# ---- group: sticky y steps
python_6 = PythonScript(x=panel_10)  # -> out, ySteps; inputs x: list
# ---------- python_6: Python ----------
"""
Realtime Simulator

written by Yan "Ryan" Zhang <ryanz@mit.edu>
for MIT Media Lab, Changing Place Group, CityScope Project
March.7th.2016
"""

import scriptcontext as sc

sc.sticky["ySteps"] = x

ySteps = sc.sticky["ySteps"]
# ---------- end python_6 ----------

# ---- group: sticky moduleIDs
python_7 = PythonScript(x=panel_12)  # -> out, moduleIDs; inputs x: list
# ---------- python_7: Python ----------
"""
Realtime Simulator

written by Yan "Ryan" Zhang <ryanz@mit.edu>
for MIT Media Lab, Changing Place Group, CityScope Project
March.7th.2016
"""

import scriptcontext as sc

sc.sticky["moduleIDs"] = x

moduleIDs = sc.sticky["moduleIDs"]
# ---------- end python_7 ----------

# ---- group: sticky x steps
python_8 = PythonScript(x=panel_9)  # -> out, xSteps; inputs x: list
# ---------- python_8: Python ----------
"""
Realtime Simulator

written by Yan "Ryan" Zhang <ryanz@mit.edu>
for MIT Media Lab, Changing Place Group, CityScope Project
March.7th.2016
"""

import scriptcontext as sc

sc.sticky["xSteps"] = x

xSteps = sc.sticky["xSteps"]
# ---------- end python_8 ----------

# ----
panel_18 = Panel(python_5.rotations)
panel_19 = Panel(python_5.out)
panel_20 = Panel(python_6.ySteps)
panel_21 = Panel(python_6.out)
panel_22 = Panel(python_8.xSteps)
panel_23 = Panel(python_8.out)
panel_24 = Panel(python_7.moduleIDs)
panel_25 = Panel(python_7.out)

# ---- group: heights for predict
num_4 = Number(panel_16)

# ----
split_4 = SplitList(List=num_4, Index=1)  # -> ListA, ListB
