# Grasshopper definition 160407_CityMatrix.gh (Grasshopper 0.9.76)
# plug-ins: Python Interpreter, gHowl, HDTReference, LunchBox

# ---- group: mesh coloring
com_color = ColourSwatch(SwatchColor=RGB(255, 122, 122))
com_gray = ColourSwatch(SwatchColor=RGB(171, 171, 171))
res_color = ColourSwatch(SwatchColor=RGB(251, 255, 122))
mesh = Mesh([<mesh referenced from the Rhino model> x2])
sidewalk = ColourSwatch(SwatchColor=RGB(107, 107, 107))
bikelane = ColourSwatch(SwatchColor=RGB(86, 135, 87))
res_gray = ColourSwatch(SwatchColor=RGB(227, 227, 227))
parking = ColourSwatch(SwatchColor=RGB(196, 156, 100))
blank = ColourSwatch(SwatchColor=RGB(110, 110, 110))
road = ColourSwatch(SwatchColor=RGB(64, 64, 64))
park = ColourSwatch(SwatchColor=RGB(165, 201, 44))
# 3D City Grid System
text = ColourSwatch(SwatchColor=RGB(0, 0, 0))
mcol = MeshColours(Mesh=mesh, Colours=bikelane)
mesh_2 = Mesh(mcol)

# ---- group: shrink
cell_shrink = Slider(0.98, range=0.75..1)

# ---- group: module meshes lego ref: -1
mesh_3 = Mesh(<mesh referenced from the Rhino model>)

# ---- group: module meshes lego ref: 0 to 5
mesh_4 = Mesh([<mesh referenced from the Rhino model> x6])

# ---- group: colortizer orgin
# CityMatrix
# 
# by Yan "Ryan" Zhang <ryanz@mit.edu>
# for MIT Media Lab, Changing Place Group, CityScope Project
# March.17th.2016
# LEGO Grid System
pt = Point(<point referenced from the Rhino model>)

# ---- group: module meshes lego ref: 6 line bike
mesh_5 = Mesh(<mesh referenced from the Rhino model>)  # disabled

# ---- group: table size ref pt
pt_2 = Point(<point referenced from the Rhino model>)

# ---- group: module meshes lego ref: 6 line car
mesh_6 = Mesh(<mesh referenced from the Rhino model>)  # disabled

# ----
panel = Panel("7002")  # disabled
# PEVs
panel_2 = Panel("127.0.0.1")  # disabled
pt_3 = Point([Point(906.25, 156.25, 0), Point(906.25, 531.25, 0), Point(906.25, 781.25, 0), Point(906.25, 656.25, 0), Point(906.25, 281.25, 0), Point(156.25, 906.25, 0)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])
crossings = Point([Point(156.25, 281.25, 0), Point(468.75, 281.25, 0), Point(718.75, 281.25, 0), Point(156.25, 656.25, 0), Point(468.75, 656.25, 0), Point(718.75, 656.25, 0), Point(906.25, 906.25, 0), Point(718.75, 906.25, 0), Point(468.75, 906.25, 0), Point(156.25, 906.25, 0), Point(906.25, 281.25, 0), Point(906.25, 656.25, 0), Point(906.25, 781.25, 0), Point(906.25, 531.25, 0), Point(906.25, 156.25, 0)])

# ---- group: 3D building site move amount
X = UnitX(Factor="10000")

# ----
swatch = ColourSwatch(SwatchColor=RGB(255, 255, 255))  # disabled
panel_3 = Panel("C:\Users\RYAN\Documents\GitHub\CityMatrix\Map\PEV_PSG AND PKG_300DPI.png")  # disabled
panel_4 = Panel("0.01")  # disabled
xy = XYPlane(Origin=pt)
dist = Distance(PointA=pt, PointB=pt_2)
mesh_7 = Mesh(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)  # disabled
_4_commed = Slider(6, range=1..25)
_1_resmed = Slider(4, range=1..25)
_3_comhq = Slider(3, range=1..25)
timer = Timer(TimerInterval=500, Target=division)  # disabled

# ---- group: 6 intersect bike
mesh_8 = Mesh(<mesh referenced from the Rhino model>)  # disabled

# ---- group: 6 intersect car
mesh_9 = Mesh(<mesh referenced from the Rhino model>)  # disabled

# ----
_0_reslux = Slider(1, range=1..25)
_2_resmu = Slider(20, range=1..25)
_5_rescw = Slider(20, range=1..25)

# ---- group: udp receiver
udp = UDPReceiver(Address=panel_2, Port=panel, Pattern=0)  # -> Info, Data; disabled

# ---- group: ref mesh
# Traffic Heatmap - Yasushi
mesh_10 = Mesh(<mesh referenced from the Rhino model>)

# ---- group: private car / road quator 0s
mesh_11 = Mesh([<mesh referenced from the Rhino model> x4])
pt_4 = Point(<point referenced from the Rhino model>)

# ----
movetoorgin = MoveToOrgin(G=mesh_3, num=cell_shrink)
movetoorgin_2 = MoveToOrgin(G=mesh_4, num=cell_shrink)

# ---- group: base cplane
pln = Plane(xy)

# ----
split = TextSplit(Text=udp.Data)  # disabled

# ---- group: PEV center pt
pt_5 = Point(split)  # disabled

# ----
vec2pt = Vector2Pt(PointA=Point(0, 0, 0), PointB=pt_5, Unitize=False)  # -> Vector, Length; disabled
move = Move(Geometry=mesh_7, Motion=vec2pt.Vector)  # -> Geometry, Transform; disabled
vec = Vector(X)
com = ColourSwatch(SwatchColor=RGB(158, 158, 158))
res = ColourSwatch(SwatchColor=RGB(212, 212, 212))
mjoin = MeshJoin(Meshes=move.Geometry)  # disabled
movetoorgin_3 = MoveToOrgin(G=mesh_10, num=cell_shrink)
srf = Surface(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)

# ---- group: private car / road quator 1s
mesh_12 = Mesh([<mesh referenced from the Rhino model> x4])
pt_6 = Point(<point referenced from the Rhino model>)

# ---- group: private car
scale_nu = ScaleNU(Geometry=mesh_11, Plane=pt_4, ScaleX=cell_shrink, ScaleY=cell_shrink, ScaleZ=1)  # -> Geometry, Transform
scale_nu_2 = ScaleNU(Geometry=mesh_12, Plane=pt_6, ScaleX=cell_shrink, ScaleY=cell_shrink, ScaleZ=1)  # -> Geometry, Transform

# ----
merge = Merge(Data1=_0_reslux, Data2=_1_resmed, Data3=_2_resmu, Data4=_3_comhq, Data5=_4_commed, Data6=_5_rescw)
merge_2 = Merge(Data1=res, Data2=res, Data3=res, Data4=com, Data5=com, Data6=com)

# ---- group: PEVs
previewmat = CustomPreviewMaterials(Geometry=mjoin, DiffuseColor=swatch, Transparency=panel_4, DiffuseBitmap=panel_3)  # disabled

# ---- group: module meshes lego at orgin
mesh_13 = Mesh(movetoorgin_2)

mesh_14 = Mesh(movetoorgin)

# ---- group: PEV / road quator 0s
mesh_15 = Mesh([<mesh referenced from the Rhino model> x4])
pt_7 = Point(<point referenced from the Rhino model>)

# ----
pshift = ShiftPaths(Data=movetoorgin_3, Offset=-1)

# ---- group: color for each type
col = Colour(merge_2)

# ---- group: floor num for each type
int = Integer(merge)

# ---- group: floor height
panel_5 = Panel("3.5")

# ---- group: PEV / road quator 1s
mesh_16 = Mesh([<mesh referenced from the Rhino model> x4])
pt_8 = Point(<point referenced from the Rhino model>)

# ---- group: PEV
scale_nu_3 = ScaleNU(Geometry=mesh_15, Plane=pt_7, ScaleX=cell_shrink, ScaleY=cell_shrink, ScaleZ=1)  # -> Geometry, Transform
scale_nu_4 = ScaleNU(Geometry=mesh_16, Plane=pt_8, ScaleX=cell_shrink, ScaleY=cell_shrink, ScaleZ=1)  # -> Geometry, Transform

# ---- group: ref mesh at orgin
mesh_17 = Mesh(pshift)

# ----
move_2 = Move(Geometry=mesh_17, Motion=pt_3)  # -> Geometry, Transform
multiplication = Multiplication(A=int, B=panel_5)

# ---- group: base height
panel_6 = Panel("5.0")

# ---- group: building height for each type
num = Number(multiplication)

# ----
Z = UnitZ(Factor=Slider(4.9, range=0..10))

# ---- group: translate example
pt_9 = Point(Point(-15, -8, 0))  # disabled
python = PythonScript(point=pt_9)  # -> out, output; inputs point: Point3d; disabled
# ---------- python: Python ----------
import Rhino

transform = Rhino.Geometry.Transform.Translation(0,0,5)
point.Transform(transform)

output = point
# ---------- end python ----------

# ----
panel_7 = Panel(num)
move_3 = Move(Geometry=move_2.Geometry, Motion=Z)  # -> Geometry, Transform
panel_8 = Panel("216 Pearl St. Cambridge")
number_slider = Slider(10, range=10..100)
panel_9 = Panel("C:\Users\RYAN\Documents\GitHub\CityMatrix\Data\colortizer_data_rhino_02_YZ.txt")
panel_10 = Panel("C:\Users\RYAN\Documents\GitHub\CityMatrix\Data\colortizer_data_sample.txt")
# Parsing Colortizer Data (CityMatrix 16x16)
panel_11 = Panel("C:\Users\RYAN\Documents\GitHub\CityMatrix\Data\colortizer_data.txt")

# ---- group: meshes lego ref: parking
mesh_18 = Mesh(<mesh referenced from the Rhino model>)

# ----
panel_12 = Panel("C:\Users\RYAN\Documents\GitHub\CityMatrix\Data\colortizer_data_rhino_01_YZ.txt")

# ---- group: meshes lego ref: park
mesh_19 = Mesh(<mesh referenced from the Rhino model>)

# ----
Z_2 = UnitZ(Factor=number_slider)
msphereex = MeshSphereEx(Base=Z_2, Radius=number_slider, Count=Slider(5, range=0..10))
Z_3 = UnitZ(Factor=Slider(6, range=0..10))
movetoorgin_4 = MoveToOrgin(G=mesh_18, num=cell_shrink)
movetoorgin_5 = MoveToOrgin(G=mesh_19, num=cell_shrink)
move_4 = Move(Geometry=msphereex, Motion=Z_3)  # -> Geometry, Transform

# ---- group: udp receiver
udp_2 = UDPReceiver(Address="127.0.0.1", Port="7001", Pattern=0)  # -> Info, Data

# ----
mcol_2 = MeshColours(Mesh=move_4.Geometry, Colours=park)
tree_scale = Slider(0.81, range=0.5..2)
split_2 = TextSplit(Text=udp_2.Data)

# ---- group: reading txt
file = ReadFile(File=panel_9, PerLineParse=True)

# ---- group: module meshes lego at orgin
mesh_20 = Mesh(movetoorgin_4)

mesh_21 = Mesh(movetoorgin_5)

# ----
shift = ShiftList(List=split_2, Shift=1, Wrap=False)

# ---- group: meshes 3D ref: Tree
mesh_22 = Mesh(mcol_2)

# ---- group: overwrite toggle 1 - trans mode
transportation_mode = BooleanToggle(False)

# ---- group: toggle1
bool = Boolean(transportation_mode)

# ---- group: traffic mode is PEV
bool_2 = Boolean(bool)

# ---- group: toggle1
bool_3 = Boolean(bool)

# ----
filter = StreamFilter(Gate=bool_3, Stream0=scale_nu.Geometry, Stream1=scale_nu_3.Geometry)
filter_2 = StreamFilter(Gate=bool_3, Stream0=scale_nu_2.Geometry, Stream1=scale_nu_4.Geometry)
mesh_23 = Mesh(filter_2)
mesh_24 = Mesh(filter)
filter_3 = StreamFilter(Gate=bool_3, Stream0=pt_4, Stream1=pt_7)
filter_4 = StreamFilter(Gate=bool_3, Stream0=pt_6, Stream1=pt_8)
pt_10 = Point(filter_4)
pt_11 = Point(filter_3)
txt = Text(file)
txt_2 = Text(shift)

# ---- group: 3D building site move amount
vec_2 = Vector(X)

# ----
tree = Slider(2.13, range=0..5)

# ---- group: colortizer data
txt_3 = Text(txt)

# ----
panel_13 = Panel(txt_3)

# ---- group: parking cell #
parking_cell = Slider(18, range=0..50)

# ---- group: total parking cell number
# Parking & Park
int_2 = Integer(parking_cell)

# ----
split_3 = SplitList(List=txt_3, Index=9)  # -> ListA, ListB
multiplication_2 = Multiplication(A="3", B=tree)
multiplication_3 = Multiplication(A="3", B=tree)
dom = ConstructDomain(DomainStart=multiplication_2, DomainEnd=multiplication_3)
pt_12 = Point(<point referenced from the Rhino model>)

# ---- group: park cell #
park_cell = Slider(33, range=0..50)

# ---- group: total park cell number
int_3 = Integer(park_cell)

# ----
pshift_2 = ShiftPaths(Data=split_3.ListB, Offset=-1)
pshift_3 = ShiftPaths(Data=split_3.ListA, Offset=-1)
item = ListItem(List=pshift_3, Index=4, Wrap=False)
item_2 = ListItem(List=pshift_3, Index=2, Wrap=False)
item_3 = ListItem(List=pshift_3, Index=3, Wrap=False)
item_4 = ListItem(List=pshift_3, Index=5, Wrap=False)
item_5 = ListItem(List=pshift_3, Index=6, Wrap=False)
item_6 = ListItem(List=pshift_3, Index=7, Wrap=False)
item_7 = ListItem(List=pshift_3, Index=1, Wrap=False)
item_8 = ListItem(List=pshift_3, Index=0, Wrap=False)
item_9 = ListItem(List=pshift_3, Index=8, Wrap=False)
split_4 = TextSplit(Text=item, Separators="\t")
split_5 = TextSplit(Text=item_2, Separators="\t")
split_6 = TextSplit(Text=item_3, Separators="\t")
split_7 = TextSplit(Text=item_4, Separators="\t")
split_8 = TextSplit(Text=item_5, Separators="\t")
split_9 = TextSplit(Text=item_6, Separators="\t")
split_10 = TextSplit(Text=item_7, Separators="\t")
split_11 = TextSplit(Text=item_8, Separators="\t")
split_12 = TextSplit(Text=item_9, Separators="\t")
pshift_4 = ShiftPaths(Data=split_4, Offset=1)
pshift_5 = ShiftPaths(Data=split_5, Offset=1)
pshift_6 = ShiftPaths(Data=split_6, Offset=1)
pshift_7 = ShiftPaths(Data=split_7, Offset=1)
pshift_8 = ShiftPaths(Data=split_8, Offset=1)
pshift_9 = ShiftPaths(Data=split_9, Offset=1)
pshift_10 = ShiftPaths(Data=split_10, Offset=1)
pshift_11 = ShiftPaths(Data=split_11, Offset=1)
pshift_12 = ShiftPaths(Data=split_12, Offset=1)
item_10 = ListItem(List=pshift_4, Index=0, Wrap=False)
item_11 = ListItem(List=pshift_5, Index=0, Wrap=False)
item_12 = ListItem(List=pshift_6, Index=0, Wrap=False)
item_13 = ListItem(List=pshift_7, Index=0, Wrap=False)
item_14 = ListItem(List=pshift_8, Index=0, Wrap=False)
item_15 = ListItem(List=pshift_9, Index=0, Wrap=False)
item_16 = ListItem(List=pshift_10, Index=0, Wrap=False)
item_17 = ListItem(List=pshift_11, Index=0, Wrap=False)
item_18 = ListItem(List=pshift_12, Index=0, Wrap=False)
txt_4 = Text(item_10)
txt_5 = Text(item_11)
txt_6 = Text(item_12)
txt_7 = Text(item_13)
txt_8 = Text(item_14)
txt_9 = Text(item_15)
txt_10 = Text(item_16)
txt_11 = Text(item_17)
txt_12 = Text(item_18)
pt_13 = Point(<point referenced from the Rhino model>)
panel_14 = Panel(txt_4)
panel_15 = Panel(txt_5)
panel_16 = Panel(txt_6)
panel_17 = Panel(txt_7)
panel_18 = Panel(txt_8)
panel_19 = Panel(txt_9)
panel_20 = Panel(txt_10)
panel_21 = Panel(txt_11)
panel_22 = Panel(txt_12)
item_19 = ListItem(List=pshift_4, Index=1, Wrap=False)

# ---- group: dockRotation
int_4 = Integer(item_19)

int_5 = Integer(item_19)

# ----
item_20 = ListItem(List=pshift_5, Index=1, Wrap=False)
item_21 = ListItem(List=pshift_6, Index=1, Wrap=False)

# ---- group: dockID
int_6 = Integer(item_21)

int_7 = Integer(item_21)

# ----
item_22 = ListItem(List=pshift_7, Index=1, Wrap=False)

# ---- group: slider1
num_2 = Number(item_22)

num_3 = Number(item_22)

# ----
item_23 = ListItem(List=pshift_8, Index=1, Wrap=False)

# ---- group: toggle1
bool_4 = Boolean(item_23)

bool_5 = Boolean(item_23)

# ----
panel_23 = Panel(bool_5)
item_24 = ListItem(List=pshift_9, Index=1, Wrap=False)

# ---- group: toggle2
bool_6 = Boolean(item_24)

bool_7 = Boolean(item_24)

# ----
item_25 = ListItem(List=pshift_10, Index=1, Wrap=False)

# ---- group: gridExtent_x
int_8 = Integer(item_25)

int_9 = Integer(item_25)

# ----
division = Division(A=dist, B=int_8)

# ---- group: cell size
num_4 = Number(division)

num_5 = Number(division)

# ----
division_2 = Division(A=num_5, B=2)
multiplication_4 = Multiplication(A=division_2, B=Slider(0.95, range=0..1))
multiplication_5 = Multiplication(A="8", B=num_4)
neg = Negative(Value=multiplication_4)
dom_2 = ConstructDomain(DomainStart=neg, DomainEnd=multiplication_4)
pt_14 = ConstructPoint(XCoordinate=multiplication_5, YCoordinate=0, ZCoordinate=0)
yz = YZPlane(Origin=pt_14)
mirror = Mirror(Geometry=move_3.Geometry, Plane=yz)  # -> Geometry, Transform
move_5 = Move(Geometry=mirror.Geometry, Motion=vec)  # -> Geometry, Transform

# ---- group: gridExtent_x
# Dashboard
int_10 = Integer(item_25)

# ---- group: cell size
num_6 = Number(division)

# ----
division_3 = Division(A=num_6, B=2.5)
division_4 = Division(A=num_5, B=2)
neg_2 = Negative(Value=division_3)

# ---- group: cell area
sqr = Square(Value=num_5)

# ----
multiplication_6 = Multiplication(A=sqr, B=Slider(0.25, range=0..1))
num_7 = Number(multiplication_6)
dom_3 = ConstructDomain(DomainStart=neg_2, DomainEnd=division_3)

# ---- group: ppl per m2
multiplication_7 = Multiplication(A=num_7, B="0.018181")
multiplication_8 = Multiplication(A=num_7, B="0.05454")
multiplication_9 = Multiplication(A=num_7, B="0.0666667")
multiplication_10 = Multiplication(A=num_7, B="0.01123")
multiplication_11 = Multiplication(A=num_7, B="0.2")
multiplication_12 = Multiplication(A=num_7, B="0.0337")

# ----
panel_24 = Panel(multiplication_7)
panel_25 = Panel(multiplication_10)
panel_26 = Panel(multiplication_9)
panel_27 = Panel(multiplication_12)
panel_28 = Panel(multiplication_8)
panel_29 = Panel(multiplication_11)
item_26 = ListItem(List=pshift_11, Index=1, Wrap=False)
item_27 = ListItem(List=pshift_12, Index=1, Wrap=False)

# ---- group: toggle2
bool_8 = Boolean(item_27)

bool_9 = Boolean(item_27)

# ----
total_ppl = Slider(28269, range=700..30000)

# ---- group: dockRotation
int_11 = Integer(item_19)

# ---- group: IDMax
int_12 = Integer(item_20)

# ---- group: dockID
int_13 = Integer(item_21)

# ---- group: slider1
num_8 = Number(item_22)

# ---- group: toggle1
bool_10 = Boolean(item_23)

# ---- group: toggle2
bool_11 = Boolean(item_24)

# ---- group: gridExtent_x
int_14 = Integer(item_25)

# ---- group: gridIndex
int_15 = Integer(item_26)

# ---- group: toggle2
bool_12 = Boolean(item_27)

# ----
panel_30 = Panel(int_11)
panel_31 = Panel(int_12)
panel_32 = Panel(int_13)
panel_33 = Panel(num_8)
panel_34 = Panel(bool_10)
panel_35 = Panel(bool_11)
panel_36 = Panel(int_14)
panel_37 = Panel(int_15)
panel_38 = Panel(bool_12)
item_28 = ListItem(List=pshift_10, Index=2, Wrap=False)

# ---- group: gridExtent_y
int_16 = Integer(item_28)

int_17 = Integer(item_28)

int_18 = Integer(item_28)

int_19 = Integer(item_28)

# ----
pt_15 = Point(<point referenced from the Rhino model>)
panel_39 = Panel(int_19)
subtraction = Subtraction(A=int_14, B=1)
multiplication_13 = Multiplication(A=int_14, B=int_19)
split_13 = SplitList(List=pshift_2, Index=multiplication_13)  # -> ListA, ListB
pshift_13 = ShiftPaths(Data=split_13.ListA, Offset=-1)
split_14 = TextSplit(Text=pshift_13, Separators="\t")
pshift_14 = ShiftPaths(Data=split_14, Offset=1)

# ---- group: all data
int_20 = Integer(pshift_14)

# ----
panel_40 = Panel(int_20)
item_29 = ListItem(List=int_20, Index="3", Wrap=False)
item_30 = ListItem(List=int_20, Index="0", Wrap=False)
item_31 = ListItem(List=int_20, Index="1", Wrap=False)
item_32 = ListItem(List=int_20, Index="2", Wrap=False)
pshift_15 = ShiftPaths(Data=item_30, Offset=-1)
pshift_16 = ShiftPaths(Data=item_31, Offset=-1)
pshift_17 = ShiftPaths(Data=item_32, Offset=-1)
pshift_18 = ShiftPaths(Data=item_29, Offset=-1)
neg_3 = Negative(Value=pshift_18)

# ---- group: module id
int_21 = Integer(pshift_15)

int_22 = Integer(int_21)

int_23 = Integer(int_21)

# ----
larger = LargerThan(FirstNumber=int_22, SecondNumber="0")  # -> LargerThan, OrEqualTo
smaller = SmallerThan(FirstNumber=int_22, SecondNumber="5")  # -> SmallerThan, OrEqualTo
and = GateAnd(A=larger.OrEqualTo, B=smaller.OrEqualTo)

# ---- group: is building or not
bool_13 = Boolean(and)

# ----
dispatch = Dispatch(List=int_22, DispatchPattern=bool_13)  # -> ListA, ListB

# ---- group: building id
int_24 = Integer(dispatch.ListA)

# ----
larger_2 = LargerThan(FirstNumber=int_23, SecondNumber="0")  # -> LargerThan, OrEqualTo
smaller_2 = SmallerThan(FirstNumber=int_23, SecondNumber="5")  # -> SmallerThan, OrEqualTo
item_33 = ListItem(List=col, Index=graft(int_24), Wrap=False)
and_2 = GateAnd(A=larger_2.OrEqualTo, B=smaller_2.OrEqualTo)
pshift_19 = ShiftPaths(Data=item_33, Offset=-1)
dispatch_2 = Dispatch(List=int_23, DispatchPattern=and_2)  # -> ListA, ListB
smaller_3 = SmallerThan(FirstNumber=int_23, SecondNumber="0")  # -> SmallerThan, OrEqualTo
item_34 = ListItem(List=mesh_13, Index=graft(dispatch_2.ListA), Wrap=False)

# ---- group: color for each building
col_2 = Colour(pshift_19)

# ----
item_35 = ListItem(List=panel_7, Index=graft(int_24), Wrap=False)
pshift_20 = ShiftPaths(Data=item_34, Offset=-1)
pshift_21 = ShiftPaths(Data=item_35, Offset=-1)

# ---- group: building height of each building
num_9 = Number(pshift_21)

# ----
addition = Addition(A=num_9, B=panel_6)
dom_4 = ConstructDomain(DomainStart=0, DomainEnd=addition)
equals = Equality(FirstNumber=int_23, SecondNumber="7")  # -> Equality, Inequality
equals_2 = Equality(FirstNumber=int_23, SecondNumber="6")  # -> Equality, Inequality
or = GateOr(A=equals_2.Equality, B=equals.Equality)

# ---- group: module id
int_25 = Integer(int_21)

# ----
equals_3 = Equality(FirstNumber=int_25, SecondNumber="0")  # -> Equality, Inequality
equals_4 = Equality(FirstNumber=int_25, SecondNumber="1")  # -> Equality, Inequality
equals_5 = Equality(FirstNumber=int_25, SecondNumber="3")  # -> Equality, Inequality
equals_6 = Equality(FirstNumber=int_25, SecondNumber="2")  # -> Equality, Inequality
equals_7 = Equality(FirstNumber=int_25, SecondNumber="4")  # -> Equality, Inequality
equals_8 = Equality(FirstNumber=int_25, SecondNumber="5")  # -> Equality, Inequality
int_26 = Integer(equals_3.Equality)
int_27 = Integer(equals_4.Equality)
int_28 = Integer(equals_5.Equality)
int_29 = Integer(equals_6.Equality)
int_30 = Integer(equals_7.Equality)
int_31 = Integer(equals_8.Equality)
ma = MassAddition(Input=int_26)  # -> Result, PartialResults
ma_2 = MassAddition(Input=int_27)  # -> Result, PartialResults
ma_3 = MassAddition(Input=int_28)  # -> Result, PartialResults
ma_4 = MassAddition(Input=int_29)  # -> Result, PartialResults
ma_5 = MassAddition(Input=int_30)  # -> Result, PartialResults
ma_6 = MassAddition(Input=int_31)  # -> Result, PartialResults
int_32 = Integer(ma.Result)
panel_41 = Panel(int_32)
int_33 = Integer(ma_2.Result)
panel_42 = Panel(int_33)
int_34 = Integer(ma_3.Result)
panel_43 = Panel(int_34)
int_35 = Integer(ma_4.Result)
panel_44 = Panel(int_35)
int_36 = Integer(ma_5.Result)
panel_45 = Panel(int_36)
int_37 = Integer(ma_6.Result)
panel_46 = Panel(int_37)

# ---- group: Micro-unit Building #
int_38 = Integer(int_35)

# ---- group: Regular residential Building #
int_39 = Integer(int_33)

# ---- group: Luxury Building #
int_40 = Integer(int_32)

# ---- group: Head Quater Building #
int_41 = Integer(int_34)

# ---- group: Regular Office Building #
int_42 = Integer(int_36)

# ---- group: Co-working Building #
int_43 = Integer(int_37)

# ----
multiplication_14 = Multiplication(A=_4_commed, B=int_42)
multiplication_15 = Multiplication(A=_1_resmed, B=int_39)
multiplication_16 = Multiplication(A=_5_rescw, B=int_43)
multiplication_17 = Multiplication(A=_2_resmu, B=int_38)
multiplication_18 = Multiplication(A=_3_comhq, B=int_41)
multiplication_19 = Multiplication(A=_0_reslux, B=int_40)

multiplication_20 = Multiplication(A=panel_28, B=multiplication_14)
multiplication_21 = Multiplication(A=panel_24, B=multiplication_15)
multiplication_22 = Multiplication(A=panel_29, B=multiplication_16)
multiplication_23 = Multiplication(A=panel_26, B=multiplication_17)
multiplication_24 = Multiplication(A=panel_27, B=multiplication_18)
multiplication_25 = Multiplication(A=panel_25, B=multiplication_19)

# ---- group: Head Quater ppl #
int_44 = Integer(multiplication_24)

# ---- group: Co-working ppl #
int_45 = Integer(multiplication_22)

# ---- group: Micro-unit ppl #
int_46 = Integer(multiplication_23)

# ---- group: Luxury ppl #
int_47 = Integer(multiplication_25)

# ---- group: Regular residential ppl #
int_48 = Integer(multiplication_21)

# ---- group: Regular Office ppl #
int_49 = Integer(multiplication_20)

# ----
join = TextJoin(Text=flatten([" - Regular: ", int_48]))
join_2 = TextJoin(Text=flatten([" - Micro-unit: ", int_46]))
join_3 = TextJoin(Text=flatten([" - Luxury: ", int_47]))
ma_7 = MassAddition(Input=[int_45, int_49, int_44])  # -> Result, PartialResults
ma_8 = MassAddition(Input=[int_46, int_48, int_47])  # -> Result, PartialResults

# ---- group: total working ppl #
int_50 = Integer(ma_7.Result)

# ---- group: total residential ppl #
int_51 = Integer(ma_8.Result)

# ----
join_4 = TextJoin(Text=flatten(["Residential: ", int_51]))
join_5 = TextJoin(Text=[join_4, join_3, join, join_2])

# ---- group: residential list
tag = TextTag3D(
    Location=pt_13,
    Text=join_5,
    Size=Slider(11.8, range=0..100),
    Colour=ColourSwatch(SwatchColor=RGB(201, 201, 201)),
    Justification=1)

# ----
addition_2 = Addition(A=int_51, B=int_50)

# ---- group: total ppl #
int_52 = Integer(addition_2)

# Energy per Capita Heatmap
int_53 = Integer(int_52)

# ----
int_54 = Integer(int_53)
congestion = PythonScript(A=crossings, S=srf, P=pt_3, N=int_54, B=bool_2)  # -> out, C, t; inputs A: list, P: list
# ---------- congestion: Python ----------
import random 
import rhinoscriptsyntax as rs

ratio = float((N-700)/(35000.0-700.0))

C=[]
t=[]

#print ratio

hue = 50 - 50 * ratio
alpha = 255 * ratio

if B :
    hue += 45
    alpha /= float(3)

min_distance = []

for p in P:
    mind = 10000000
    for a in A:
        d = rs.Distance(a,p)
        if d < mind:
            mind = d
    distance =  (1-mind/250) * 0.2 
    hue += distance*2
    if not B:
        t.append((60-hue)*1.5)
    else:
        t.append((100-hue)*0.5)
    C.append(rs.ColorHLSToRGB((hue+random.randint(-2,2),128,255,alpha+random.randint(-5,5))));
# ---------- end congestion ----------
gradient = Gradient(
    LowerLimit=0,
    UpperLimit=100,
    Parameter=congestion.t,
    stops=[0: RGB(110, 110, 110), 0.472: RGB(237, 74, 74), 1: RGB(255, 0, 0)])
pshift_22 = ShiftPaths(Data=gradient, Offset=-1)
preview = CustomPreview(Geometry=[mirror.Geometry, move_5.Geometry], Shader=gradient)
panel_47 = Panel(congestion.t)
# Human Interaction
amenities = PythonScript(N=int_52)  # -> out, A
# ---------- amenities: Python ----------
import math

title = ["density","subway_station","department_store","embassy","beauty_salon","police","courthouse","cemetery","pharmacy","local_government_office","shopping_mall","city_hall","rv_park","shoe_store","bank","bowling_alley","school","bar","university","car_dealer","taxi_stand","grocery_or_supermarket","fire_station","church","convenience_store","campground","lawyer","parking","post_office","hindu_temple","hardware_store","meal_takeaway","movie_rental","gas_station","funeral_home","aquarium","restaurant","home_goods_store","atm","veterinary_care","airport","locksmith","bus_station","hospital","night_club","electrician","mosque","amusement_park","lodging","florist","liquor_store","museum","car_rental","stadium","store","hair_care","transit_station","meal_delivery","gym","park","dentist","library","book_store","painter","roofing_contractor","moving_company","clothing_store","furniture_store","physiotherapist","casino","art_gallery","car_wash","movie_theater","spa","accounting","cafe","car_repair","synagogue","real_estate_agency","electronics_store","doctor","bicycle_store","storage","zoo","train_station","jewelry_store","laundry","insurance_agency","plumber","pet_store","bakery","travel_agency"]

newyork = [27673,10,6,10,74,3,0,0,29,27,16,0,0,28,111,2,35,200,6,13,0,20,2,13,23,1,200,89,6,0,0,74,5,0,0,0,200,102,183,2,1,7,41,22,60,16,0,0,140,12,7,9,7,0,200,60,51,28,35,13,135,31,18,5,1,28,200,21,46,1,26,1,35,39,200,96,18,0,200,105,200,2,11,0,0,200,29,200,9,2,37,177]
atlanta = [700,0,0,0,15,0,0,0,3,2,1,0,0,2,4,0,4,31,1,0,0,2,1,5,3,0,200,10,0,0,1,4,0,1,0,0,46,13,7,1,0,0,11,8,7,0,0,0,5,0,1,1,0,0,59,15,11,2,7,0,25,0,0,2,1,1,8,7,2,0,3,1,0,11,8,9,3,0,22,3,58,0,0,0,0,0,6,22,2,2,2,4]

ratio = (N - atlanta[0]) / float(newyork[0] - atlanta[0])
print ratio

amenities = {}

for i in range(len(title))[1:]:
    amenity =  title[i]
    num =  math.floor(atlanta[i]+(newyork[i]-atlanta[i]) * ratio)
    
    if title[i].startswith('law'): continue
    if title[i].startswith('jew'): continue
    if title[i].startswith('accoun'): continue
    if title[i].startswith('store'): continue
    if title[i].startswith('travel'): continue
    if title[i].startswith('cloth'): continue
    if title[i].startswith('local_'): continue
    if title[i].startswith('electronic'): continue
    if title[i].startswith('dent'): continue
    if title[i].startswith('insu'): continue
    if title[i].startswith('physio'): continue
    if title[i].startswith('real'): continue
    if title[i].startswith('doc'): continue
    if title[i].startswith('storage'): continue
    if title[i].startswith('painter'): continue
    if title[i].startswith('moving'): continue
    if title[i].startswith('subway'): continue
    if title[i].startswith('meal'): continue
    if title[i].startswith('embassy'): continue
    if title[i].startswith('shoe'): continue
    
    if num > 2:
        amenities[title[i]] = num

result = []
cnt = 0

for amenity in sorted(amenities, key=lambda k: amenities[k], reverse=True):
    cnt += 1
    if cnt%4 <= 1 : continue
    result.append('{}: {}'.format(amenity,int(amenities[amenity])))
    

print result

A = result
# ---------- end amenities ----------
panel_48 = Panel(amenities.A)
join_6 = TextJoin(Text=panel_48)

# ---- group: amenity list
tag_2 = TextTag3D(
    Location=pt_12,
    Text=join_6,
    Size=Slider(11.8, range=0..100),
    Colour=ColourSwatch(SwatchColor=RGB(201, 201, 201)),
    Justification=1)

# ----
join_7 = TextJoin(Text=flatten(["Office: ", int_50]))
join_8 = TextJoin(Text=flatten([" - Regular: ", int_49]))
join_9 = TextJoin(Text=flatten([" - Co-working: ", int_45]))
join_10 = TextJoin(Text=flatten([" - Headquarter: ", int_44]))
join_11 = TextJoin(Text=[join_7, join_10, join_8, join_9])
panel_49 = Panel(int_52)

# ---- group: residential list
tag_3 = TextTag3D(
    Location=pt_15,
    Text=join_11,
    Size=Slider(11.8, range=0..100),
    Colour=ColourSwatch(SwatchColor=RGB(201, 201, 201)),
    Justification=1)

# ----
subtraction_2 = Subtraction(A=subtraction, B=pshift_16)

# ---- group: x
int_55 = Integer(subtraction_2)

int_56 = Integer(int_55)

int_57 = Integer(int_55)

int_58 = Integer(int_55)

# ---- group: y
int_59 = Integer(pshift_17)

int_60 = Integer(int_59)

int_61 = Integer(int_59)

# ---- group: road check matrix
python_2 = PythonScript(xe=int_8, ye=int_16, x=int_57, y=int_61, id=int_23)  # -> out, m; inputs x: list, y: list, id: list
# ---------- python_2: Python ----------
"""
CityMatrix

written by "Ryan" Yan Zhang <ryanz@mit.edu>
for MIT Media Lab, Changing Place Group
April.6th.2016
"""

import rhinoscriptsyntax as rs

m = [[-1 for n in range(xe)] for n in range(ye)]

for n in range(len(id)):
    if id[n] == 7:
        m[y[n]][x[n]] = 6
    else:
        m[y[n]][x[n]] = id[n]

for n in range(ye):
    print m[n]
# ---------- end python_2 ----------

# ----
modulecenter = ModuleCenter(pt=pt, num=num_4, int_2=int_57, int=int_61)  # -> pt_5, transform_2

# ---- group: road check list
python_3 = PythonScript(xe=int_8, ye=int_16, x=int_57, y=int_61, id=int_23, m=python_2.m)  # -> out, rdType; inputs x: list, y: list, id: list, m: list
# ---------- python_3: Python ----------
"""
CityMatrix

written by "Ryan" Yan Zhang <ryanz@mit.edu>
for MIT Media Lab, Changing Place Group
April.6th.2016
"""

import rhinoscriptsyntax as rs

rdType = []

for n in range(len(id)):
    
    code = []
    
    if id[n]==6 or id[n]==7:
        
        # 0: check x, y+1
        if y[n]+1>ye-1:
            code.append(1)
        else:
            if m[y[n]+1][x[n]]==6:
                code.append(1)
            else:
                code.append(0)
        
        # 1: check x+1, y
        if x[n]+1>xe-1:
            code.append(1)
        else:
            if m[y[n]][x[n]+1]==6:
                code.append(1)
            else:
                code.append(0)
        
        # 2: check x, y-1
        if y[n]-1<0:
            code.append(1)
        else:
            if m[y[n]-1][x[n]]==6:
                code.append(1)
            else:
                code.append(0)
        
        # 3: check x-1, y
        if x[n]-1<0:
            code.append(1)
        else:
            if m[y[n]][x[n]-1]==6:
                code.append(1)
            else:
                code.append(0)
    
    else:
        
        code = [0,0,0,0]
    
    print code
    rdType.append(code)
# ---------- end python_3 ----------

# ----
xform = Transform(modulecenter.transform_2)  # disabled

# ---- group: module center
pt_16 = Point(modulecenter.pt_5)

pt_17 = Point(pt_16)

# ---- group: road check list
python_4 = PythonScript(pt=pt_16, id=int_23, rdType=python_3.rdType, rdQua0=mesh_24, c0=pt_11, rdQua1=mesh_23, c1=pt_10)  # -> out, allRoadMesh; inputs pt: list, id: list, rdType: list, rdQua0: list, rdQua1: list
# ---------- python_4: Python ----------
"""
CityMatrix

written by "Ryan" Yan Zhang <ryanz@mit.edu>
for MIT Media Lab, Changing Place Group
April.6th.2016
"""

import rhinoscriptsyntax as rs
import Rhino.Geometry as rg

allRoadMesh = []

for n in range(len(id)):
    
    if id[n]==6 or id[n]==7:
        
        for i in range(len(rdType[n])):
            t = rdType[n][i]
            v = rs.PointCoordinates(pt[n])
            if t == 0:
                c = rs.PointCoordinates(c0)
                vx = v[0]-c[0]
                vy = v[1]-c[1]
                new = rs.CopyObject(rdQua0[i],(vx,vy,0.))
            else:
                c = rs.PointCoordinates(c1)
                vx = v[0]-c[0]
                vy = v[1]-c[1]
                new = rs.CopyObject(rdQua1[i],(vx,vy,0.))
            allRoadMesh.append(new)
# ---------- end python_4 ----------

# ---- group: road mesh final!
mesh_25 = Mesh(python_4.allRoadMesh)

# ----
dispatch_3 = Dispatch(List=pt_17, DispatchPattern=bool_13)  # -> ListA, ListB

# ---- group: building center
pt_18 = Point(dispatch_3.ListA)

# ----
move_6 = Move(Geometry=mesh_25, Motion=vec)  # -> Geometry, Transform
box = DomainBox(Base=pt_18, X=dom_2, Y=dom_2, Z=dom_4)
dispatch_4 = Dispatch(List=pt_16, DispatchPattern=smaller_3.SmallerThan)  # -> ListA, ListB
vec2pt_2 = Vector2Pt(PointA=Point(0, 0, 0), PointB=dispatch_4.ListA, Unitize=False)  # -> Vector, Length
move_7 = Move(Geometry=box, Motion=vec)  # -> Geometry, Transform
dispatch_5 = Dispatch(List=pt_16, DispatchPattern=and_2)  # -> ListA, ListB
move_8 = Move(Geometry=mesh_14, Motion=vec2pt_2.Vector)  # -> Geometry, Transform

# ---- group: building geo
box_2 = Box(move_7.Geometry)

# ---- group: textured buildings
panel_50 = Panel("C:\Users\RYAN\Documents\GitHub\CityMatrix\Map\PEV_PSG AND PKG_300DPI.png")  # disabled
panel_51 = Panel("0.01")  # disabled
swatch_2 = ColourSwatch(SwatchColor=RGB(255, 255, 255))  # disabled
boxmap = BoxMapping(Mesh=box_2, Box=box_2)  # disabled
previewmat_2 = CustomPreviewMaterials(Geometry=boxmap, DiffuseColor=swatch_2, Transparency=panel_51, DiffuseBitmap=panel_50)  # disabled

# ----
vec2pt_3 = Vector2Pt(PointA=Point(0, 0, 0), PointB=dispatch_5.ListA, Unitize=False)  # -> Vector, Length
dispatch_6 = Dispatch(List=pt_16, DispatchPattern=or)  # -> ListA, ListB

# ---- group: road mesh final!
mesh_26 = Mesh(python_4.allRoadMesh)

# ---- group: blank
mesh_27 = Mesh(move_8.Geometry)

mesh_28 = Mesh(mesh_27)

# ----
move_9 = Move(Geometry=mesh_28, Motion=vec)  # -> Geometry, Transform

# ---- group: 3D Buldings
preview_2 = CustomPreview(Geometry=box_2, Shader=col_2)

# ---- group: blank
mesh_29 = Mesh(move_9.Geometry)

# ---- group: road
mesh_30 = Mesh(move_6.Geometry)

# ---- group: road center pts
pt_19 = Point(dispatch_6.ListA)

# ---- group: y
int_62 = Integer(int_59)

# ---- group: blank modules
mesh_31 = Mesh(mesh_27)

# ----
geobottomcenter = GeoBottomCenter_2(geo=mesh_31)
lng = ListLength(List=geobottomcenter)
division_5 = Division(A=int_2, B=lng)
randomsplit = RandomSplitList(MasterList=geobottomcenter, Seed=Slider(32, range=0..100), Split=division_5)  # -> ListA, ListB
lng_2 = ListLength(List=randomsplit.ListA)
division_6 = Division(A=int_3, B=lng_2)
randomsplit_2 = RandomSplitList(MasterList=randomsplit.ListA, Seed=Slider(25, range=0..100), Split=division_6)  # -> ListA, ListB

# ---- group: parking center
pt_20 = Point(randomsplit.ListB)

# ---- group: park center lego
pt_21 = Point(randomsplit_2.ListB)

# ----
move_10 = Move(Geometry=pt_21, Motion=vec_2)  # -> Geometry, Transform

# ---- group: park center 3D
pt_22 = Point(move_10.Geometry)

# ----
planesrf = PlaneSurface(Plane=pt_22, XSize=dom_3, YSize=dom_3)
lng_3 = ListLength(List=pt_22)
random = Random(Range="0.8 to 1.4", Number=lng_3, Seed=Slider(72, range=0..100))
multiplication_26 = Multiplication(A=random, B=tree_scale)
scale = Scale(Geometry=mesh_22, Center=Point(0, 0, 0), Factor=multiplication_26)  # -> Geometry, Transform
random_2 = Random(Range=dom, Number=lng_3, Seed=Slider(17, range=0..100))
random_3 = Random(Range=Domain(0, 1000), Number=lng_3, Seed=Slider(35, range=0..100))
vec2pt_4 = Vector2Pt(PointA=Point(0, 0, 0), PointB=pt_21, Unitize=False)  # -> Vector, Length
vec2pt_5 = Vector2Pt(PointA=Point(0, 0, 0), PointB=pt_20, Unitize=False)  # -> Vector, Length
popgeo = PopulateGeometry(Geometry=flatten(planesrf), Count=flatten(random_2), Seed=flatten(random_3))
move_11 = Move(Geometry=mesh_21, Motion=vec2pt_4.Vector)  # -> Geometry, Transform
move_12 = Move(Geometry=mesh_20, Motion=vec2pt_5.Vector)  # -> Geometry, Transform

# ---- group: tree center
pt_23 = Point(flatten(popgeo))

# ----
vec2pt_6 = Vector2Pt(PointA=Point(0, 0, 0), PointB=pt_23, Unitize=False)  # -> Vector, Length
move_13 = Move(Geometry=scale.Geometry, Motion=vec2pt_6.Vector)  # -> Geometry, Transform

# ---- group: parking lego
mesh_32 = Mesh(move_11.Geometry)

# ----
move_14 = Move(Geometry=mesh_32, Motion=vec_2)  # -> Geometry, Transform

# ---- group: parking 3D
mesh_33 = Mesh(move_14.Geometry)

# ---- group: parking lego
mesh_34 = Mesh(move_12.Geometry)

# ----
move_15 = Move(Geometry=mesh_34, Motion=vec_2)  # -> Geometry, Transform

# ---- group: parking 3D
mesh_35 = Mesh(move_15.Geometry)

# ---- group: trees 3D
mesh_36 = Mesh(move_13.Geometry)

# ---- group: rotation
int_63 = Integer(neg_3)

int_64 = Integer(int_63)

int_65 = Integer(int_63)

# ----
dispatch_7 = Dispatch(List=int_65, DispatchPattern=and_2)  # -> ListA, ListB
rotate = Rotate(Geometry=pshift_20, Angle=degrees(dispatch_7.ListA), Plane=PlaneXY(0, 0, 0))  # -> Geometry, Transform
move_16 = Move(Geometry=rotate.Geometry, Motion=vec2pt_3.Vector)  # -> Geometry, Transform

# ---- group: building lego modules
mesh_37 = Mesh(move_16.Geometry)

# ---- group: rotation
int_66 = Integer(int_63)

# ----
panel_52 = Panel(int_55)
panel_53 = Panel(int_59)
panel_54 = Panel(int_63)
panel_55 = Panel(int_21)

# ---- group: total cell #
int_67 = Integer(multiplication_13)

# ----
panel_56 = Panel(int_67)

# ---- group: sticky rotations
python_5 = PythonScript(x=int_63)  # -> out, rotations; inputs x: list; disabled
# ---------- python_5: Python ----------
"""
Realtime Simulator

written by Yan "Ryan" Zhang <ryanz@mit.edu>
for MIT Media Lab, Changing Place Group, CityScope Project
March.7th.2016
"""

import scriptcontext as sc

sc.sticky["rotations"] = x

rotations = sc.sticky["rotations"]
# ---------- end python_5 ----------

# ---- group: sticky y steps
python_6 = PythonScript(x=int_59)  # -> out, ySteps; inputs x: list; disabled
# ---------- python_6: Python ----------
"""
Realtime Simulator

written by Yan "Ryan" Zhang <ryanz@mit.edu>
for MIT Media Lab, Changing Place Group, CityScope Project
March.7th.2016
"""

import scriptcontext as sc

sc.sticky["ySteps"] = x

ySteps = sc.sticky["ySteps"]
# ---------- end python_6 ----------

# ---- group: sticky moduleIDs
python_7 = PythonScript(x=int_21)  # -> out, moduleIDs; inputs x: list; disabled
# ---------- python_7: Python ----------
"""
Realtime Simulator

written by Yan "Ryan" Zhang <ryanz@mit.edu>
for MIT Media Lab, Changing Place Group, CityScope Project
March.7th.2016
"""

import scriptcontext as sc

sc.sticky["moduleIDs"] = x

moduleIDs = sc.sticky["moduleIDs"]
# ---------- end python_7 ----------

# ---- group: sticky x steps
python_8 = PythonScript(x=int_55)  # -> out, xSteps; inputs x: list; disabled
# ---------- python_8: Python ----------
"""
Realtime Simulator

written by Yan "Ryan" Zhang <ryanz@mit.edu>
for MIT Media Lab, Changing Place Group, CityScope Project
March.7th.2016
"""

import scriptcontext as sc

sc.sticky["xSteps"] = x

xSteps = sc.sticky["xSteps"]
# ---------- end python_8 ----------

# ----
panel_57 = Panel(python_5.rotations)  # disabled
panel_58 = Panel(python_5.out)  # disabled
panel_59 = Panel(python_6.ySteps)  # disabled
panel_60 = Panel(python_6.out)  # disabled
panel_61 = Panel(python_8.xSteps)  # disabled
panel_62 = Panel(python_8.out)  # disabled
panel_63 = Panel(python_7.moduleIDs)  # disabled
panel_64 = Panel(python_7.out)  # disabled

# ==== cluster ModuleCenter
pt = ClusterInput()
int = ClusterInput()
num = ClusterInput()
int_2 = ClusterInput()

# ---- group: y
int_3 = Integer(int)

# ---- group: cell size
num_2 = Number(num)

# ---- group: x
int_4 = Integer(int_2)

# ---- group: center
pt_2 = Point(pt)

# ----
pt_3 = ConstructPoint(XCoordinate=0, YCoordinate=0, ZCoordinate=0)  # disabled
addition = Addition(A=int_4, B=0.5)
vec2pt = Vector2Pt(PointA=pt_3, PointB=pt_2, Unitize=False)  # -> Vector, Length; disabled
addition_2 = Addition(A=int_3, B=0.5)
multiplication = Multiplication(A=addition, B=num_2)
move = Move(Motion=vec2pt.Vector)  # -> Geometry, Transform; disabled
lng = ListLength(List=int_4)  # disabled
multiplication_2 = Multiplication(A=addition_2, B=num_2)
X = UnitX(Factor=multiplication)
repeat = RepeatData(Data=move.Transform, Length=lng)  # disabled
neg = Negative(Value=multiplication_2)
move_2 = Move(Geometry=pt_2, Motion=X)  # -> Geometry, Transform
graft = GraftTree(Tree=move_2.Transform, IncludeEmptyLists=True, IncludeNullItems=True)  # disabled
Y = UnitY(Factor=neg)
pshift = ShiftPaths(Data=repeat, Offset=-1)  # disabled
move_3 = Move(Geometry=move_2.Geometry, Motion=Y)  # -> Geometry, Transform
graft_2 = GraftTree(Tree=move_3.Transform, IncludeEmptyLists=True, IncludeNullItems=True)  # disabled
comp = Compound(Transforms=[graft, graft_2])  # disabled
graft_3 = GraftTree(Tree=pshift, IncludeEmptyLists=True, IncludeNullItems=True)  # disabled
comp_2 = Compound(Transforms=[comp, graft_3])  # disabled

# ---- group: module center
pt_4 = Point(move_3.Geometry)

# ----
pshift_2 = ShiftPaths(Data=comp_2, Offset=-1)  # disabled
transform = Transform(pshift_2)  # disabled
pt_5 = ClusterOutput(pt_4)
transform_2 = ClusterOutput(transform)  # disabled

# ==== cluster MoveToOrgin
num = ClusterInput()
G = ClusterInput()
num_2 = Number(num)
geobottomcenter = GeoBottomCenter(geo=G)
vec2pt = Vector2Pt(PointA=geobottomcenter, PointB=Point(0, 0, 0), Unitize=False)  # -> Vector, Length
move = Move(Geometry=G, Motion=vec2pt.Vector)  # -> Geometry, Transform
scale_nu = ScaleNU(Geometry=move.Geometry, Plane=PlaneXY(0, 0, 0), ScaleX=num_2, ScaleY=num_2, ScaleZ=1)  # -> Geometry, Transform
G_2 = ClusterOutput(scale_nu.Geometry)

# ==== cluster GeoBottomCenter_2
geo = ClusterInput()
geo_2 = Geometry(geo)
bbox = BoundingBox(Content=geo_2, Plane=PlaneXY(0, 0, 0))  # -> Box, Box_2
box_corners = BoxCorners(Box=bbox.Box)  # -> CornerA, CornerB, CornerC, CornerD, CornerE, CornerF, CornerG, CornerH
pdecon = Deconstruct(Point=box_corners.CornerA)  # -> XComponent, YComponent, ZComponent
pdecon_2 = Deconstruct(Point=box_corners.CornerC)  # -> XComponent, YComponent, ZComponent
addition = Addition(A=pdecon.XComponent, B=pdecon_2.XComponent)
addition_2 = Addition(A=pdecon.YComponent, B=pdecon_2.YComponent)
division = Division(A=addition, B=2)
division_2 = Division(A=addition_2, B=2)
pt = ConstructPoint(XCoordinate=division, YCoordinate=division_2, ZCoordinate=pdecon.ZComponent)
pshift = ShiftPaths(Data=pt, Offset=-1)
pt_2 = Point(pshift)
pt_3 = ClusterOutput(pt_2)

# ==== cluster GeoBottomCenter
geo = ClusterInput()
geo_2 = Geometry(geo)
bbox = BoundingBox(Content=geo_2, Plane=PlaneXY(0, 0, 0))  # -> Box, Box_2
box_corners = BoxCorners(Box=bbox.Box)  # -> CornerA, CornerB, CornerC, CornerD, CornerE, CornerF, CornerG, CornerH
pdecon = Deconstruct(Point=box_corners.CornerA)  # -> XComponent, YComponent, ZComponent
pdecon_2 = Deconstruct(Point=box_corners.CornerC)  # -> XComponent, YComponent, ZComponent
addition = Addition(A=pdecon.XComponent, B=pdecon_2.XComponent)
addition_2 = Addition(A=pdecon.YComponent, B=pdecon_2.YComponent)
division = Division(A=addition, B=2)
division_2 = Division(A=addition_2, B=2)
pt = ConstructPoint(XCoordinate=division, YCoordinate=division_2, ZCoordinate=pdecon.ZComponent)
pt_2 = Point(pt)
pt_3 = ClusterOutput(pt_2)
